# Grasshopper definition test_connection_info.ghx (Grasshopper 1.0.7)
# plug-ins: AutodeskPlatformServices

# ---- group: Build Connection from App Id, Secret, Account Id
cci = ConstructConnectionInfo(
    AppId="<enter app id here>",
    AppSecret="<enter app secret here>",
    AccountId="<enter account id here>",
    ListenerPort=Slider(8080, range=0..10000))

# ---- group: Build Connection from Environment Variables
ccie = ConstructConnectionInfoEnvVars(
    AppIdVariable="FORGE_CLIENT_ID",
    AppSecretVariable="FORGE_CLIENT_SECRET",
    AccountIdVariable="FORGE_ACCOUNT_ID",
    ListenerPortVariable="FORGE_CALLBACK_PORT")

# ----
panel = Panel(cci)
C = Connect(ConnectionInfo=ccie)
panel_2 = Panel(ccie)
query_groups = QueryGroups(ConnectionInfo=C)
dcci = DecostructConnectionInfo(ConnectionInfo=C)  # -> AppId, AppSecret, AccountId, CallbackUri, Token, RefreshToken
panel_3 = Panel([dcci.AppId, dcci.AppSecret, dcci.AccountId, dcci.CallbackUri])
panel_4 = Panel(dcci.Token)
panel_5 = Panel(query_groups)
cherry_picker = CherryPicker(query_groups, ListIndex=1)
qpc = QueryCollections(ConnectionInfo=C, ParametersGroup=cherry_picker)
panel_6 = Panel(qpc)
deconstruct_parameter_collection = DeconstructParameterCollection(ParameterCollection=qpc)  # -> Id, Name
panel_7 = Panel(deconstruct_parameter_collection.Id)
panel_8 = Panel(deconstruct_parameter_collection.Name)
